# Grasshopper definition test 01.gh (Grasshopper 1.0.7)
# plug-ins: Robot, TestPlugin

F = File(["C:\Repo\ROBOT_BI\FlatsOBD\1.5S_type1_46.48_b_L_D.json", "C:\Repo\ROBOT_BI\FlatsOBD\1.5S_type1_46.48_b_L_U.json", "C:\Repo\ROBOT_BI\FlatsOBD\1.5S_type1_46.48_b_R_D.json", "C:\Repo\ROBOT_BI\FlatsOBD\1.5S_type1_46.48_b_R_U.json", "C:\Repo\ROBOT_BI\FlatsOBD\1.5S_type2_48.40_b_L_D.json", "C:\Repo\ROBOT_BI\FlatsOBD\1.5S_type2_48.40_b_L_U.json"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])
F_2 = File("C:\Repo\ROBOT_BI\Modules\Apt_combinations\combinations_9.txt")
file = ReadFile(File=F, PerLineParse=False)
file_2 = ReadFile(File=F_2, PerLineParse=False)
readflat = ReadFlat(JSON=file)  # -> flatten(Flat)
item = ListItem(Index=0, Wrap=True)
nickname = TestPlugin(Flats=readflat, Combinations=file_2)  # disabled
number_slider = Slider(1000, range=0..1000)
c_script = CSharpScript(x=readflat, Reference="C:\Repo\c-sharp-tasks\08_TestPlugin\TestPlugin\References\Robot.dll")  # -> out, A
# ---------- c_script: C# usings ----------
using Robot;
# ---------- c_script: C# ----------
    var flat = x as Robot.Flat;
    A = flat.Code;
# ---------- end c_script ----------
deflat = DeconstructFlat(Flat=readflat)  # -> ID, Contour, Windows, Door, Plane, Rooms, GrossArea, Top, Bottom
panel = Panel(nickname)
item_2 = ListItem(List=nickname, Index=0, Wrap=True)
panel_2 = Panel(c_script.A)
X = UnitX(Factor=Slider(37100, range=0..100000))
bbox = BoundingBox(Content=deflat.Contour, Plane=PlaneXY(0, 0, 0))  # -> Box, Box_2
Y = UnitY(Factor=Slider(2321, range=0..10000))
delevel = DeconstructLevel(Level=nickname)  # -> ID, FloorNo, Flats, LLU, Contour, MOP, Walls, AptType
box_corners = BoxCorners(Box=bbox.Box)  # -> graft(CornerA), graft(CornerB), graft(CornerC), graft(CornerD), CornerE, CornerF, CornerG, CornerH
move = Move(Geometry=item_2, Motion=X)  # -> Geometry, Transform
item_3 = ListItem(List=delevel.Flats, Index=Slider(3, range=0..10), Wrap=True)
number_slider_2 = Slider(1500, range=0..10000)
avr = Average(Input=[box_corners.CornerA, box_corners.CornerB])
avr_2 = Average(Input=[box_corners.CornerA, box_corners.CornerB, box_corners.CornerC, box_corners.CornerD])
avr_3 = Average(Input=[box_corners.CornerC, box_corners.CornerD])
move_2 = Move(Geometry=avr_3, Motion=Y)  # -> Geometry, Transform
deflat_2 = DeconstructFlat(Flat=delevel.Flats)  # -> ID, Contour, Windows, Door, Plane, Rooms, GrossArea, Top, Bottom
panel_3 = Panel(deflat_2.ID)
panel_4 = Panel(deflat_2.Top)
crv = Curve(deflat_2.Contour)
panel_5 = Panel(deflat_2.Bottom)
tag = TextTag3D(Location=avr, Text=graft(deflat.Bottom), Size=number_slider_2, Justification=7)
tag_2 = TextTag3D(Location=avr_3, Text=graft(deflat.Top), Size=number_slider_2, Justification=7)
tag_3 = TextTag3D(Location=avr_2, Text=graft(panel_2), Size=number_slider_2, Justification=5)
tag_4 = TextTag(Location=avr_3)
tag_5 = TextTag3D(Location=move_2.Geometry, Text=graft(deflat.ID), Size=Slider(500, range=0..1000), Justification=5)
